# Grasshopper definition multihull_fairing.gh (Grasshopper 1.0.8)
# Copyright: © 2023 SYD all rights reserved
# Copyright: © SYD 2022
# plug-ins: Pufferfish

increase_inner_chine = Number()
T = Tree()
sheerline_inboard_f = Number()
sheerline_inboard_ht = Number()
asymmetry_f = Number()
hard_bilge = Boolean()
hourglass_figure = Boolean()
stem_corr_f = StemCorrF()
transom_cutting_srf = Surface()
sheerline_inboard_ht_2 = Number(sheerline_inboard_ht)
sheerline_inboard_f_2 = Number(sheerline_inboard_f)
asymmetry_f_2 = Number(asymmetry_f)
increase_inner_chine_2 = Number(increase_inner_chine)
hard_bilge_2 = Boolean(hard_bilge)
hourglass_figure_2 = Boolean(hourglass_figure)
clean = CleanTree(RemoveNulls=True, RemoveInvalid=True, RemoveEmpty=False, Tree=T)
panel = Panel("""DeckC
StemF
ChineW
ChineA
Pname""")
object = ModelObject(LoftingO=clean)  # -> Object, Geometry, Name
item = ListItem(List=flatten(clean), Index=0, Wrap=True)
u_text = UserText(Content=item, Keys=panel, UserTextMode=1)  # -> Content, Keys, Values
item_2 = ListItem(List=flatten(object.Object), Index=0, Wrap=True)  # -> Item, Item1, Item2
panel_2 = Panel(u_text.Keys)

# ---- group: Inner Crvs flattened
mirror = Mirror(Geometry=object.Geometry, Plane=Plane(origin=(0, 0, 0), x=(0, 0, 1), y=(1, 0, 0)))  # -> Geometry, Transform
scale_nu = ScaleNU(Geometry=mirror.Geometry, Plane=PlaneXY(0, 0, 0), ScaleX=1, ScaleY=asymmetry_f_2, ScaleZ=1)  # -> Geometry, Transform
concat = Concatenate(FragmentA=object.Name, FragmentB=" in")
object_2 = ModelObject(Geometry=scale_nu.Geometry, Name=concat)
item_3 = ListItem(List=flatten(object_2), Index=0, Wrap=True)  # -> Item, Item1, Item2
object_3 = ModelObject(item_3.Item)
object_4 = ModelObject(item_3.Item1)
object_5 = ModelObject(item_3.Item2)

# ---- group: If it's called outer chine it is hard chine
object_6 = ModelObject(Object=item_2.Item1)  # -> Object, Name
panel_3 = Panel(object_6.Name)
tmatch = MatchText(Text=object_6.Name, Pattern="*outer*", Case=True)

# ----
item_4 = ListItem(List=u_text.Values, Index=0, Wrap=True)  # -> Item, Item1, Item2, Item3, Item4
deck_curvature = Number(item_4.Item)
mirror_2 = Mirror(Geometry=item_2.Item2, Plane=Plane(origin=(0, 0, 0), x=(0, 0, 1), y=(1, 0, 0)))  # -> Geometry, Transform
object_7 = ModelObject(item_2.Item)
object_8 = ModelObject(item_2.Item1)
object_9 = ModelObject(item_2.Item2)
tweencrv = TweenCurve(CurveA=item_2.Item2, CurveB=mirror_2.Geometry, Factor=0.5, BlendType=0)

# ---- group: Asym sheer
cp = ControlPoints(Curve=item_3.Item)  # -> Points, Weights, Knots
pdecon = Deconstruct(Point=cp.Points)  # -> XComponent, YComponent, ZComponent
item_5 = ListItem(List=pdecon.XComponent, Index=0, Wrap=True)
expression = Expression(x=pdecon.XComponent, xs=item_5, hf=sheerline_inboard_ht_2, z=pdecon.ZComponent, Expression="(((x-xs)*hf-(x-xs))/10)+1*z")
expression_2 = Expression(y=pdecon.YComponent, f=sheerline_inboard_f_2, Expression="y*f")
pt = ConstructPoint(XCoordinate=pdecon.XComponent, YCoordinate=expression_2, ZCoordinate=expression)
nurbs = NurbsCurve(Vertices=pt, Degree=3, Periodic=False)  # -> Curve, Length, Domain

# ---- group: Hard bilge asymmetrical
dispatch = Dispatch(List=tweencrv, DispatchPattern=hard_bilge_2)  # -> ListA, ListB

# ----
scale_nu_2 = ScaleNU(Geometry=object_4, Plane=PlaneXY(0, 0, 0), ScaleX=1, ScaleY=expr("1+x/100", increase_inner_chine_2), ScaleZ=1)  # -> Geometry, Transform

# ---- group: Aft end of sheerline
end = EndPoints(Curve=object_7)  # -> Start, End
pdecon_2 = Deconstruct(Point=[end.Start, end.End])  # -> XComponent, YComponent, ZComponent
abs = Absolute(Value=pdecon_2.XComponent)
sort = SortList(Keys=abs, ValuesA=[end.Start, end.End])  # -> Keys, ValuesA
dispatch_2 = Dispatch(List=sort.ValuesA, DispatchPattern=[True, False])  # -> ListA, ListB

# ---- group: Sheer line flaired
end_2 = EndPoints(Curve=nurbs.Curve)  # -> Start, End
scale_nu_3 = ScaleNU(Geometry=object_3, Plane=PlaneXY(0, 0, 0), ScaleX=1, ScaleY=sheerline_inboard_f_2, ScaleZ=1)  # -> Geometry, Transform

# ---- group: Topsides
loft_opt = LoftOptions(Closed=False, Adjust=True, Rebuild=111, Refit=0, Type=3)
loft_opt_2 = LoftOptions(Closed=False, Adjust=True, Rebuild=111, Refit=0, Type=3)
hull = Loft(Curves=flatten([nurbs.Curve, scale_nu_2.Geometry]), Options=loft_opt_2)
hull_2 = Loft(Curves=[object_7, object_8], Options=loft_opt)

# ---- group: Tucked-in waist
Z = UnitZ(Factor=1)
move = Move(Geometry=object_8, Motion=Z)  # -> Geometry, Transform
move_2 = Move(Geometry=object_4, Motion=Z)  # -> Geometry, Transform
entwine = Entwine(
    Branch00=object_7,
    Branch01=object_8,
    Branch02=move.Geometry,
    Branch03=object_9,
    Branch04=dispatch.ListA,
    Branch05=object_5,
    Branch06=move_2.Geometry,
    Branch07=object_4,
    Branch08=scale_nu_3.Geometry,
    FlattenInputs=True)  # -> flatten(Result)
dispatch_3 = Dispatch(List=entwine, DispatchPattern=tmatch)  # -> ListA, ListB

# ----
debrep = DeconstructBrep(Brep=[hull_2, hull])  # -> Faces, Edges, Vertices

# ---- group: Transom mid Pt
addition = Addition(A=deck_curvature, B=1)
pdecon_3 = Deconstruct(Point=dispatch_2.ListB)  # -> XComponent, YComponent, ZComponent
multiplication = Multiplication(A=deck_curvature, B=pdecon_3.ZComponent)
multiplication_2 = Multiplication(A=addition, B=multiplication)
addition_2 = Addition(A=pdecon_3.XComponent, B=multiplication_2)
addition_3 = Addition(A=pdecon_3.ZComponent, B=multiplication)
pt_2 = ConstructPoint(XCoordinate=addition_2, YCoordinate=0, ZCoordinate=addition_3)

# ---- group: Wide chine Crvs
len = Length(Curve=debrep.Edges)
ma = MassAddition(Input=len)  # -> Result, PartialResults
edgeslen = EdgesFromLength(Brep=debrep.Faces, Minimum=expr("x/4", ma.Result), Maximum=ma.Result)  # -> Edges, Indices
midpt = CurveMiddle(Curve=edgeslen.Edges)
pdecon_4 = Deconstruct(Point=midpt)  # -> XComponent, YComponent, ZComponent
sort_2 = SortList(Keys=pdecon_4.ZComponent, ValuesA=edgeslen.Edges)  # -> Keys, ValuesA
item_6 = ListItem(List=sort_2.ValuesA, Index=0, Wrap=True)
dispatch_4 = Dispatch(List=flatten(item_6), DispatchPattern=[True, False])  # -> ListA, ListB

# ----
midpt_2 = CurveMiddle(Curve=debrep.Edges)

# ---- group: Aft edge of sheerline
pdecon_5 = Deconstruct(Point=midpt_2)  # -> XComponent, YComponent, ZComponent
abs_2 = Absolute(Value=pdecon_5.XComponent)
sort_3 = SortList(Keys=abs_2, ValuesA=debrep.Edges)  # -> Keys, ValuesA

# ---- group: Transom if not cutting
arc = Arc3Pt(TransomCorner=dispatch_2.ListB, TransomCl=pt_2, TransomCorner_2=end_2.End)  # -> DeckAftCrv, Plane, Radius

# ----
crv = Curve(dispatch_4.ListB)

# ---- group: Topside edge @ bow
item_7 = ListItem(List=sort_3.ValuesA, Index=0, Wrap=True)
dispatch_5 = Dispatch(List=flatten(item_7), DispatchPattern=[True, False])  # -> ListA, ListB

# ----
transom_cutting_srf_2 = Surface(transom_cutting_srf)
layers = QueryModelLayers(Name="C-deck", AutoUpdateState=True)
pt_3 = ConstructPoint(XCoordinate=0, YCoordinate=0, ZCoordinate=0)  # disabled
pl_origin = PlaneOrigin(Base=Plane(origin=(0, 0, 0), x=(0, 0, 1), y=(1, 0, 0)), Origin=pt_3)  # disabled
panel_4 = Panel("""LcB
VcB
LWL
WPA
LcF
WSA
Amax""")
entwine_2 = Entwine(FlattenInputs=True)
display = DisplayAttributes(IsocurveDensity=-11)
drafting = DraftingAttributes()  # -> Drafting, Linetype, LinetypeScale
panel_5 = Panel("""/LOAm
/Dm""")
panel_6 = Panel("""/Vol
/LcB%
/LwL
/EntryA
/Displ
/Deadrise
/DeariseT""")
entwine_3 = Entwine(FlattenInputs=True)
concat_2 = Concatenate(FragmentA="/", FragmentB=panel_4)
txt = Text(entwine_3)
txt_2 = Text(entwine_2)
merge = Merge(Data1=graft(panel_6), Data2=txt)
merge_2 = Merge(Data1=graft(concat_2), Data2=txt_2)

# ---- group: Stem
stem_factor = Number(item_4.Item1)
chine_width = Integer(item_4.Item2)
chine_angle = Integer(item_4.Item3)
flip = FlipCurve(Curve=nurbs.Curve, Guide=object_7)  # -> Curve, Flag
stem_deck_crv = StemDeckCrv(f=stem_factor, crv_1=object_8, crv_2=dispatch_4.ListB)
stem_deck_crv_2 = StemDeckCrv(f=stem_factor, crv_1=object_7, crv_2=flip.Curve)
edgesrf = EdgeSurface(CurveA=stem_deck_crv_2, CurveB=dispatch_5.ListB, CurveC=dispatch_5.ListA, CurveD=stem_deck_crv)

# ---- group: Scale inner chine line
object_10 = ModelObject(Object=item_2.Item1)  # -> Object, Geometry, Name
object_11 = ModelObject(Object=item_3.Item1)  # -> Object, Geometry, Name
object_12 = ModelObject(item_3.Item2)
panel_7 = Panel(object_11.Name)
x_tremez = Extremes(Curve=object_12, Plane=PlaneXY(0, 0, 0))  # -> Highest, Lowest
x_tremez_2 = Extremes(Curve=object_10.Geometry, Plane=Plane(origin=(0, 0, 0), x=(0, 0, 1), y=(1, 0, 0)))  # -> Highest, Lowest
panel_8 = Panel(object_10.Name)
x_tremez_3 = Extremes(Curve=object_11.Geometry, Plane=Plane(origin=(0, 0, 0), x=(0, 0, 1), y=(1, 0, 0)))  # -> Highest, Lowest
chine_height = Integer(chine_angle)
pdecon_6 = Deconstruct(Point=x_tremez_2.Lowest)  # -> XComponent, expr("ABS(x)*2", YComponent), ZComponent
pdecon_7 = Deconstruct(Point=x_tremez.Lowest)  # -> XComponent, YComponent, ZComponent
chine_width_2 = Integer(chine_width)
pdecon_8 = Deconstruct(Point=x_tremez_3.Highest)  # -> XComponent, expr("ABS(x)*2", YComponent), ZComponent
expression_3 = Expression(BOA=pdecon_6.YComponent, Cw=chine_width_2, Expression="(BOA-Cw)/BOA")
expression_4 = Expression(BOA=pdecon_8.YComponent, Cw=chine_width_2, CF=increase_inner_chine_2, Expression="(BOA-Cw)/BOA*(1+CF/100)")
expression_5 = Expression(d=pdecon_7.YComponent, Ch=chine_height, Expression="(d-Ch)/d")
end_3 = EndPoints(Curve=object_10.Geometry)  # -> Start, End
pt_4 = Point(end_3.Start)
expression_6 = Expression(p=pt_4, Expression="{p.x,0,p.z}")
scale_nu_4 = ScaleNU(Geometry=object_10.Geometry, Plane=PlaneXY(0, 0, 0), ScaleX=1, ScaleY=expression_3, ScaleZ=1)  # -> ChineOutInside, Transform
scale_nu_5 = ScaleNU(Geometry=object_11.Geometry, Plane=PlaneXY(0, 0, 0), ScaleX=1, ScaleY=expression_4, ScaleZ=1)  # -> ChineInnInside, Transform
xy = XYPlane(Origin=expression_6)
scale_nu_6 = ScaleNU(Geometry=scale_nu_4.ChineOutInside, Plane=xy, ScaleX=1, ScaleY=1, ScaleZ=expression_5)  # -> ChineOutInside, Transform
scale_nu_7 = ScaleNU(Geometry=scale_nu_5.ChineInnInside, Plane=xy, ScaleX=1, ScaleY=1, ScaleZ=expression_5)  # -> ChineInnInside, Transform
object_13 = ModelObject(Object=object_10.Object, Geometry=scale_nu_6.ChineOutInside, Name="Chine outside inner Crv")
object_14 = ModelObject(Object=object_11.Object, Geometry=scale_nu_7.ChineInnInside, Name="Chine inside inner Crv")
entwine_4 = Entwine(
    Branch00=object_13,
    Branch01=object_9,
    Branch02=dispatch.ListA,
    Branch03=object_5,
    Branch04=object_14,
    FlattenInputs=True)  # -> flatten(Result)

# ----
multiplication_3 = Multiplication(A=stem_factor, B=stem_corr_f)

# ---- group: Deck/2
edgesrf_2 = EdgeSurface(CurveA=arc.DeckAftCrv, CurveB=object_7, CurveC=stem_deck_crv_2, CurveD=flip.Curve)

# ---- group: Round bilge (one topside)
entwine_5 = Entwine(
    Branch00=object_7,
    Branch01=object_8,
    Branch02=object_9,
    Branch03=dispatch.ListA,
    Branch04=object_5,
    Branch05=object_4,
    Branch06=scale_nu_3.Geometry,
    FlattenInputs=True)  # -> flatten(Result)
dispatch_6 = Dispatch(List=entwine_5, DispatchPattern=tmatch)  # -> ListA, ListB

# ----
filter = StreamFilter(Gate=hourglass_figure_2, Stream0=dispatch_6.ListB, Stream1=dispatch_3.ListB)

dispatch_7 = Dispatch(List=entwine_4, DispatchPattern=tmatch)  # -> ListA, ListB
hull_3 = Loft(
    Curves=flatten(dispatch_7.ListA),
    Options={Adjust=True, Closed=False, LoftEnds=0, LoftSimp=0, LoftType=1, Rebuild=10, Refit=0.01})
outer_chine_wide = Curve(dispatch_4.ListA)
inner_chine_wide = Curve(dispatch_4.ListB)
canoeb_inner = Surface()

# ---- group: Stem for Asymmetrical hull
stem_srf = StemSrf(B=hull_3, stem_f=multiplication_3, f=stem_corr_f, d1=0.9, d2=0.1)  # -> C, stem_side_crv, stem_base, stem_crv, profile_crv
crv_2 = Curve(stem_srf.profile_crv)
flip_2 = FlipCurve(Curve=stem_srf.C)  # -> Curve, Flag
srf = Surface(stem_srf.stem_base)
crv_3 = Curve(stem_srf.stem_crv)

# ---- group: Round bilge (one topside) (continued)
hull_4 = Loft(Curves=flatten(filter), Options={Adjust=True, Closed=False, LoftEnds=0, LoftSimp=0, LoftType=1, Rebuild=10, Refit=0.01})
split_larger = SplitLarger(T=[hull_4, edgesrf_2], cutting_srf=transom_cutting_srf_2)  # -> flatten(larger_srf_2), smaller_srf_2, cutting_crv_2
split_larger_2 = SplitLarger(T=transom_cutting_srf_2, cutting_crv=split_larger.cutting_crv_2)  # -> larger_srf_2, smaller_srf_2, cutting_crv_2
item_8 = ListItem(List=flatten(split_larger.larger_srf_2), Index=0, Wrap=True)  # -> Item, Item1
near_cl = NearCL(srf=[split_larger_2.larger_srf_2, split_larger_2.smaller_srf_2])
topsides = Surface(item_8.Item)

# ---- group: Round bilge (one topside) / Stem for Asymmetrical hull
stem_srf_2 = StemSrf(B=hull_4, stem_f=stem_factor, f=stem_corr_f, d1=0.9, d2=0.1)  # -> C, stem_side_crv, stem_base, stem_crv, profile_crv
srf_2 = Surface(stem_srf_2.stem_base)
crv_4 = Curve(stem_srf_2.profile_crv)
flip_3 = FlipCurve(Curve=stem_srf_2.C)  # -> Curve, Flag
crv_5 = Curve(stem_srf_2.stem_crv)

# ----
srf_3 = Surface(item_8.Item1)

# ---- group: Stem (continued)
debrep_2 = DeconstructBrep(Brep=hull_3)  # -> Faces, Edges, Vertices
len_2 = Length(Curve=debrep_2.Edges)
ma_2 = MassAddition(Input=len_2)  # -> Result, PartialResults
edgeslen_2 = EdgesFromLength(Brep=hull_3, Minimum=expr("x/4", ma_2.Result), Maximum=ma_2.Result)  # -> Edges, Indices
dispatch_8 = Dispatch(List=edgeslen_2.Edges, DispatchPattern=[True, False])  # -> ListA, ListB
stem_deck_crv_3 = StemDeckCrv(f=multiplication_3, crv_1=dispatch_8.ListA, crv_2=dispatch_8.ListB)

# ---- group: Blend between stem shapes
twn2crvs = TweenTwoCurves(CurveA=stem_deck_crv_3, CurveB=stem_srf.C, Factor=0.5, Refit=0, PointSample=0)
end_4 = EndPoints(Curve=stem_deck_crv_3)  # -> Start, End
end_5 = EndPoints(Curve=twn2crvs)  # -> Start, End
planar = Planar(Curve=stem_deck_crv_3)  # -> Planar, Plane, Deviation
yz = YZPlane(Origin=Point(0, 0, 0))
dist = Distance(PointA=end_4.Start, PointB=end_4.End)
dist_2 = Distance(PointA=end_5.Start, PointB=end_5.End)
vec2pt = Vector2Pt(PointA=end_5.End, PointB=end_4.End, Unitize=False)  # -> Vector, Length
align = AlignPlanes(Planes=planar.Plane, Master=yz)
transform = Transform(Geometry=twn2crvs, Transform=vec2pt.Vector)
division = Division(A=dist, B=dist_2)
pl_origin_2 = PlaneOrigin(Base=align, Origin=end_5.End)
scale_nu_8 = ScaleNU(Geometry=transform, Plane=pl_origin_2, ScaleX=division, ScaleY=1, ScaleZ=1)  # -> Geometry, Transform

# ---- group: Round bilge (one topside) (continued)
cull_i = CullIndex(List=reverse(crv_5), Indices=-1, Wrap=True)
netsurf = NetworkSurface(CurvesU=stem_srf_2.stem_side_crv, CurvesV=flatten(cull_i), Continuity=1)  # -> flatten(StemBase)

# ----
cull_i_2 = CullIndex(List=crv_3, Indices=-1, Wrap=True)
flip_4 = FlipCurve(Curve=scale_nu_8.Geometry)  # -> Curve, Flag
outer_chine_narrow = Curve(dispatch_8.ListB)
inner_chine_narrow = Curve(dispatch_8.ListA)
flip_5 = FlipCurve(Curve=outer_chine_narrow, Guide=outer_chine_wide)  # -> Curve, Flag
flip_6 = FlipCurve(Curve=inner_chine_narrow)  # -> Curve, Flag
loft = Loft(
    Curves=flatten([outer_chine_wide, flip_5.Curve]),
    Options={Adjust=False, Closed=False, LoftEnds=0, LoftSimp=0, LoftType=0, Rebuild=10, Refit=0.01})
loft_2 = Loft(
    Curves=flatten([inner_chine_wide, flip_6.Curve]),
    Options={Adjust=False, Closed=False, LoftEnds=0, LoftSimp=0, LoftType=0, Rebuild=10, Refit=0.01})
split_larger_3 = SplitLarger(T=[hull_3, hull_2, hull, edgesrf_2, loft, loft_2], cutting_srf=transom_cutting_srf_2)  # -> flatten(larger_srf_2), smaller_srf_2, cutting_crv_2
split_larger_4 = SplitLarger(T=transom_cutting_srf_2, cutting_crv=split_larger_3.cutting_crv_2)  # -> larger_srf_2, smaller_srf_2, cutting_crv_2
item_9 = ListItem(List=split_larger_3.larger_srf_2, Index=0, Wrap=False)  # -> Item, Item1, Item2, Item3, Item4, Item5, Item6
near_cl_2 = NearCL(srf=[split_larger_4.larger_srf_2, split_larger_4.smaller_srf_2])
topsides_inner = Surface(item_9.Item2)
topsides_outer = Surface(item_9.Item1)
canoeb_outer = Surface(item_9.Item)
chine_outer = Surface(item_9.Item3)
chine_inner = Surface(item_9.Item4)
deck = Surface([item_9.Item5, item_8.Item1])
object_15 = ModelObject(Geometry=deck, Name="Deck", Layer=layers)  # -> flatten(Object), Geometry

srf_4 = Surface(item_9.Item5)

# ---- group: Transom to trim
layers_2 = QueryModelLayers(Name="C-hull", AutoUpdateState=True)
transom_srf = Surface([near_cl_2, near_cl])
object_16 = ModelObject(Geometry=transom_srf, Name="Transom", Layer=layers_2)  # -> Object, Geometry
object_17 = ModelObject(Geometry=[edgesrf, netsurf], Name="Stem upper", Layer=layers_2)  # -> flatten(Object), Geometry

# ---- group: Round bilge (one topside) (continued)
object_18 = ModelObject(Geometry=topsides, Name="Topsides", Layer=layers_2)  # -> Object, Geometry

# ----
clean_2 = CleanTree(
    RemoveNulls=True,
    RemoveInvalid=True,
    RemoveEmpty=True,
    Tree=flatten([object_15.Object, object_17.Object, object_16.Object]))
complete_srf = ModelObject(clean_2)

# ---- group: 0-width Srf = problem!!!
larger = LargerThan(FirstNumber=chine_width, SecondNumber=0)  # -> LargerThan, OrEqualTo; disabled
dispatch_9 = Dispatch(List=stem_deck_crv_3, DispatchPattern=larger.LargerThan)  # -> ListA, ListB; disabled

# ---- group: Stem (continued)
loft_3 = Loft(
    Curves=flatten([flip_4.Curve, stem_deck_crv]),
    Options={Adjust=False, Closed=False, LoftEnds=0, LoftSimp=0, LoftType=0, Rebuild=10, Refit=0.01})
netsurf_2 = NetworkSurface(CurvesU=stem_srf.stem_side_crv, CurvesV=flatten([scale_nu_8.Geometry, cull_i_2]), Continuity=1)  # -> flatten(StemBase)

# ---- group: 0-width Srf = problem!!! (continued)
dispatch_10 = Dispatch(List=loft_3, DispatchPattern=larger.LargerThan)  # -> ListA, ListB; disabled

# ---- group: Stem (continued)
debrep_3 = DeconstructBrep(Brep=dispatch_10.ListA)  # -> Faces, Edges, Vertices; disabled

# ---- group: Stem / Inside of stem chine
len_3 = Length(Curve=debrep_3.Edges)  # disabled
sort_4 = SortList(Keys=len_3, ValuesA=debrep_3.Edges)  # -> Keys, ValuesA; disabled
item_10 = ListItem(List=reverse(sort_4.ValuesA), Index=0, Wrap=True)  # -> Item, Item1; disabled

# ----
object_19 = ModelObject(Geometry=loft_3, Name="Stem Chine", Layer=layers_2)  # -> flatten(Object), Geometry
object_20 = ModelObject(Geometry=canoeb_inner, Name="CanoeB inner", Layer=layers_2)  # -> Object, Geometry
object_21 = ModelObject(Geometry=topsides_inner, Name="Topsides inner", Layer=layers_2)  # -> Object, Geometry
object_22 = ModelObject(Geometry=topsides_outer, Name="Topsides outer", Layer=layers_2)  # -> Object, Geometry
object_23 = ModelObject(Geometry=chine_inner, Name="Chine inner", Layer=layers_2)  # -> Object, Geometry
object_24 = ModelObject(Geometry=chine_outer, Name="Chine outer", Layer=layers_2)  # -> Object, Geometry
object_25 = ModelObject(Geometry=canoeb_outer, Name="CanoeB", Layer=layers_2)  # -> Object, Geometry
object_26 = ModelObject(Geometry=netsurf_2, Name="Stem lower", Layer=layers_2)  # -> flatten(Object), Geometry

clean_3 = CleanTree(
    RemoveNulls=True,
    RemoveInvalid=True,
    RemoveEmpty=True,
    Tree=flatten([object_22.Object, object_24.Object, object_25.Object, object_19.Object]))
clean_4 = CleanTree(
    RemoveNulls=True,
    RemoveInvalid=True,
    RemoveEmpty=True,
    Tree=flatten([object_21.Object, object_23.Object, object_20.Object, object_26.Object]))

# ---- group: Solid vessel
clean_5 = CleanTree(
    RemoveNulls=True,
    RemoveInvalid=True,
    RemoveEmpty=True,
    Tree=flatten([object_15.Geometry, object_21.Geometry, object_23.Geometry, object_20.Geometry, object_16.Geometry, object_25.Geometry, object_17.Geometry, object_22.Geometry, object_24.Geometry, object_26.Geometry, object_19.Geometry, object_18.Object]))
join = BrepJoin(Breps=flatten(clean_5))  # -> Vessel, Closed
capex = CapHolesEx(Brep=join.Vessel)  # -> Vessel, Caps, Solid
layers_3 = QueryModelLayers(Name="G-hull", AutoUpdateState=True)
object_27 = ModelObject(Geometry=capex.Vessel, Name=item_4.Item4, Layer=layers_3, Display=display)  # -> VesselO, Geometry, Name, Layer, Visibility, Display, Drafting, Render

# ----
object_28 = ModelObject(VesselO=object_27.VesselO)  # -> Object, Geometry, Name; disabled
bbox = BoundingBox(Content=clean_5, Plane=PlaneXY(0, 0, 0), UnionBox=True)  # -> Box, Box_2
debox = DeconstructBox(Box=bbox.Box)  # -> Plane, X, Y, Z
dedomain = DeconstructDomain(Domain=debox.Y)  # -> Start, End
dedomain_2 = DeconstructDomain(Domain=debox.Z)  # -> Start, End
dedomain_3 = DeconstructDomain(Domain=debox.X)  # -> Start, End
expression_7 = Expression(x=dedomain_2.Start, y=dedomain_2.End, Expression="Round((y-x)/1e3,3)")
expression_8 = Expression(x=dedomain_3.Start, y=dedomain_3.End, Expression="Round((y-x)/1e3,3)")
expression_9 = Expression(x=dedomain.Start, y=dedomain.End, Expression="Round(y-x)")
half_hull_inner = ModelObject(clean_4)
half_hull_outer = ModelObject(clean_3)
debrep_4 = DeconstructBrep(Brep=object_28.Geometry)  # -> Faces, Edges, Vertices; disabled
midpt_3 = CurveMiddle(Curve=debrep_4.Edges)  # disabled
mirror_3 = Mirror(Geometry=object_28.Geometry, Plane=pl_origin)  # -> StbdHull, Transform; disabled
entwine_6 = Entwine(Branch00=expression_8, Branch01=expression_7, FlattenInputs=True)
pdecon_9 = Deconstruct(Point=midpt_3)  # -> XComponent, YComponent, ZComponent; disabled
sort_5 = SortList(Keys=pdecon_9.YComponent, ValuesA=debrep_4.Edges)  # -> Keys, ValuesA; disabled
txt_3 = Text(entwine_6)
item_11 = ListItem(List=sort_5.ValuesA, Index=0, Wrap=True)  # disabled
merge_3 = Merge(Data1=graft(panel_5), Data2=txt_3)
txt_4 = Text(flatten(object_28.Name))  # disabled
x_tremez_4 = Extremes(Curve=item_11, Plane=PlaneXY(0, 0, 0))  # -> Highest, Lowest; disabled
entwine_7 = Entwine(Branch0X=merge_3, Branch1X=merge, Branch2X=merge_2, FlattenInputs=False)
panel_9 = Panel(merge_3)
pdecon_10 = Deconstruct(Point=x_tremez_4.Lowest)  # -> XComponent, YComponent, ZComponent; disabled
panel_10 = Panel(txt_4)  # disabled
R = Result(merge_3)
vessel_o = Object(object_27.VesselO)
solid = Solid(capex.Solid)
eval = Evaluate(F="Round((BCL+ABS(B2))/1e3*2,3)", B2=pdecon_10.YComponent)  # disabled
concat_3 = Concatenate(FragmentA=txt_4, FragmentB="stbd", JoinSeparator=" ")  # disabled
object_29 = ModelObject(Name=object_28.Name)  # disabled
object_30 = ModelObject(Geometry=mirror_3.StbdHull, Name=concat_3)  # disabled

# ==== cluster StemDeckCrv
f = ClusterInput()
crv_1 = ClusterInput()
crv_2 = ClusterInput()
end = EndPoints(Curve=crv_1)  # -> Start, End
end_2 = EndPoints(Curve=crv_2)  # -> Start, End
flip = FlipCurve(Curve=crv_2)  # -> Curve, Flag
eval = EvaluateCurve(Curve=reparameterize(crv_1), Parameter=0.001)  # -> Point, Tangent, Angle
eval_2 = EvaluateCurve(Curve=reparameterize(flip.Curve), Parameter=0.001)  # -> Point, Tangent, Angle
pdecon = Deconstruct(Point=end.Start)  # -> XComponent, YComponent, ZComponent
pdecon_2 = Deconstruct(Point=end.End)  # -> XComponent, YComponent, ZComponent
vec2pt = Vector2Pt(PointA=eval.Point, PointB=end.Start, Unitize=True)  # -> Vector, Length
vec2pt_2 = Vector2Pt(PointA=eval_2.Point, PointB=end_2.End, Unitize=True)  # -> Vector, Length
eval_3 = Evaluate(F="if(ABS(x)<ABS(y),ABS(x)*f,ABS(y)*f)", x=pdecon.YComponent, y=pdecon_2.YComponent, f=f)
multiplication = Multiplication(A=vec2pt.Vector, Mult=eval_3)
multiplication_2 = Multiplication(A=vec2pt_2.Vector, Mult=eval_3)
bzspan = BezierSpan(StartPoint=end.Start, StartTangent=multiplication, EndPoint=end_2.End, EndTangent=multiplication_2)  # -> StemCrv, Length, Domain
stem_crv = ClusterOutput(bzspan.StemCrv)

# ==== cluster SplitLarger
cutting_crv = ClusterInput()
cutting_srf = ClusterInput()
T = ClusterInput()
flatten = FlattenTree(Tree=T, Path="{0}")  # -> graft(Tree)
bbx = BrepBrep(Surface=flatten, CuttingSrf=cutting_srf)  # -> Curves, Points
srfsplit = SurfaceSplit(Surface=flatten, CuttingCrv=[bbx.Curves, cutting_crv])
area = Area(Geometry=srfsplit)  # -> Area, Centroid
dispatch = Dispatch(List=area.Area, DispatchPattern=[True, False])  # -> ListA, ListB
larger = LargerThan(FirstNumber=dispatch.ListA, SecondNumber=dispatch.ListB)  # -> LargerThan, OrEqualTo
not = GateNot(A=larger.LargerThan)
dispatch_2 = Dispatch(List=srfsplit, DispatchPattern=[larger.LargerThan, not])  # -> ListA, ListB
join = JoinCurves(Curves=flatten(bbx.Curves), Preserve=False)
larger_srf = Surface(dispatch_2.ListA)
smaller_srf = Surface(dispatch_2.ListB)
smaller_srf_2 = ClusterOutput(smaller_srf)
larger_srf_2 = ClusterOutput(larger_srf)
cutting_crv_2 = ClusterOutput(join)

# ==== cluster NearCL
srf = ClusterInput()

# ---- group: How many edges?
dispatch = Dispatch(List=srf, DispatchPattern=[True, False])  # -> ListA, ListB
wires = BrepWireframe(Brep=dispatch.ListB, Density=-1)
wires_2 = BrepWireframe(Brep=dispatch.ListA, Density=-1)
join = JoinCurves(Curves=wires_2, Preserve=False)
join_2 = JoinCurves(Curves=wires, Preserve=False)
lng = ListLength(List=join_2)
lng_2 = ListLength(List=join)

# ---- group: Keep inner surface
srf_2 = Surface(srf)
area = Area(Geometry=srf_2)  # -> Area, Centroid
pdecon = Deconstruct(Point=area.Centroid)  # -> XComponent, YComponent, ZComponent
abs = Absolute(Value=pdecon.YComponent)
dispatch_2 = Dispatch(List=abs, DispatchPattern=[True, False])  # -> ListA, ListB
smaller = SmallerThan(FirstNumber=dispatch_2.ListA, SecondNumber=dispatch_2.ListB)  # -> SmallerThan, OrEqualTo
not = GateNot(A=smaller.SmallerThan)
dispatch_3 = Dispatch(List=srf_2, DispatchPattern=[smaller.SmallerThan, not])  # -> ListA, ListB

# ----
larger = LargerThan(FirstNumber=lng_2, SecondNumber=lng)  # -> LargerThan, OrEqualTo
dispatch_4 = Dispatch(List=dispatch.ListA, DispatchPattern=larger.LargerThan)  # -> ListA, ListB
dispatch_5 = Dispatch(List=dispatch.ListB, DispatchPattern=larger.LargerThan)  # -> ListA, ListB
transom_srf = Surface([dispatch_4.ListB, dispatch_5.ListA])
transom_srf_2 = ClusterOutput(transom_srf)

# ==== cluster StemSrf

# ---- group: Stem
stem_f = ClusterInput()

# ----
f = ClusterInput()
B = ClusterInput()
d1 = ClusterInput()
d2 = ClusterInput()
merge = Merge(Data1=d1, Data2=d2)
dom = ConstructDomain(DomainStart="0", DomainEnd="1")
dom_2 = ConstructDomain(DomainStart="0.5", DomainEnd="1")
dom_3 = ConstructDomain(DomainStart="0", DomainEnd="0.5")
sec = BrepPlane(Brep=B, Plane=Plane(origin=(0, 0, 0), x=(0, 0, 1), y=(1, 0, 0)))  # -> Curves, Points; disabled
dom² = ConstructDomain²(DomainU=dom_2, DomainV=dom)
dom²_2 = ConstructDomain²(DomainU=dom_3, DomainV=dom)
srfsplit = SurfaceSplit(Surface=B, Curves=sec.Curves)  # disabled
subsrf = Isotrim(Surface=reparameterize(B), Domain=dom²_2)
subsrf_2 = Isotrim(Surface=reparameterize(B), Domain=dom²)
debrep = DeconstructBrep(Brep=B)  # -> Faces, Edges, Vertices
srf = Surface([subsrf, subsrf_2])
len = Length(Curve=debrep.Edges)
debrep_2 = DeconstructBrep(Brep=srf)  # -> Faces, Edges, Vertices
sort = SortList(Keys=len, ValuesA=debrep.Edges)  # -> Keys, reverse(ValuesA)
midpt = CurveMiddle(Curve=debrep_2.Edges)
pdecon = Deconstruct(Point=midpt)  # -> XComponent, YComponent, ZComponent
item = ListItem(List=sort.ValuesA, Index=0, Wrap=True)  # -> Item, Item1
sort_2 = SortList(Keys=pdecon.XComponent, ValuesA=debrep_2.Edges)  # -> Keys, ValuesA
item_2 = ListItem(List=sort_2.ValuesA, Index=0, Wrap=True)  # -> Item, Item1
dispatch = Dispatch(List=flatten(item_2.Item), DispatchPattern=[True, False])  # -> ListA, ListB
debrep_3 = DeconstructBrep(Brep=subsrf)  # -> Faces, Edges, Vertices
flip = FlipCurve(Curve=dispatch.ListA)  # -> Curve, Flag
sort_pt = SortPoints(Points=debrep_3.Vertices)  # -> Points, Indices
aligned_front_of_hull_crv = Curve([flip.Curve, dispatch.ListB])
split = SplitList(List=sort_pt.Points, Index=2)  # -> ListA, ListB
shatter = Shatter(Curve=reparameterize(aligned_front_of_hull_crv), Parameters=merge)
pdecon_2 = Deconstruct(Point=split.ListA)  # -> XComponent, YComponent, ZComponent
sort_3 = SortList(Keys=pdecon_2.ZComponent, ValuesA=split.ListA)  # -> Keys, ValuesA
dispatch_2 = Dispatch(List=shatter, DispatchPattern=[True, False])  # -> ListA, ListB
item_3 = ListItem(List=sort_3.ValuesA, Index=Slider(0, range=0..10), Wrap=True)
multiplication = Multiplication(StemF=stem_f, B=f)
crv = Curve(dispatch_2.ListB)
bow_pt = Point(item_3)
pframes = PerpFrames(Curve=crv, Count=6, Align=simplify(True))  # -> Frames, Parameters
outer_chine = Curve(item.Item1)
inner_chine = Curve(item.Item)
sec_2 = BrepPlane(Brep=graft(srf), Plane=pframes.Frames)  # -> simplify(Curves), Points

# ---- group: Stem top
cluster = Cluster(f=multiplication, inner_chine=inner_chine, outer_chine=outer_chine)

# ----
panel = Panel(pframes.Parameters)
trim = TrimTree(Tree=sec_2.Curves, Depth=1)
bang = ExplodeTree(Data=trim)  # -> Branch0, Branch1
flip_2 = FlipCurve(Curve=cluster)  # -> Curve, Flag

# ---- group: Stem mid
cluster_2 = Cluster(f=multiplication, inner_chine=bang.Branch0, outer_chine=bang.Branch1)

# ----
crv_2 = Curve(flatten([flip_2.Curve, cluster_2]))

# ---- group: Stem sides
reb = RebuildCurve(Curve=aligned_front_of_hull_crv, Degree=2, Count=1000, Tangents=True)  # -> flatten(StemSideCrv)

# ----
midpt_2 = CurveMiddle(Curve=crv_2)
pdecon_3 = Deconstruct(Point=midpt_2)  # -> XComponent, YComponent, ZComponent
sort_4 = SortList(Keys=pdecon_3.ZComponent, ValuesStemCrv=crv_2)  # -> Keys, ValuesStemCrv
netsurf = NetworkSurface(CurvesU=reb, CurvesV=sort_4.ValuesStemCrv, Continuity=1)  # -> flatten(StemBase)
midpt_3 = CurveMiddle(Curve=sort_4.ValuesStemCrv)
entwine = Entwine(Branch00=bow_pt, Branch01=midpt_3, FlattenInputs=True)  # -> flatten(Result)
points = PointList(Points=entwine, Size=20)
intcrv = Interpolate(Vertices=entwine, Degree=3, Periodic=False, KnotStyle=1)  # -> ProfileCrv, Length, Domain
C = ClusterOutput(flip_2.Curve)
stem_side_crv = ClusterOutput(reb)
stem_base = ClusterOutput(netsurf)
stem_crv = ClusterOutput(sort_4.ValuesStemCrv)
profile_crv = ClusterOutput(intcrv.ProfileCrv)

# ==== cluster Cluster
inner_chine = ClusterInput()
outer_chine = ClusterInput()
f = ClusterInput()
panel = Panel("""0
0.001
0.999
1""")
inner_chine_2 = Curve(inner_chine)
outer_chine_2 = Curve(outer_chine)
eval = EvaluateCurve(Curve=reparameterize(graft(inner_chine_2)), Parameter=panel)  # -> Point, Tangent, Angle
eval_2 = EvaluateCurve(Curve=reparameterize(graft(outer_chine_2)), Parameter=panel)  # -> Point, Tangent, Angle
x_tremez = Extremes(Curve=inner_chine_2, Plane=PlaneYZ(0, 0, 0))  # -> Highest, Lowest
x_tremez_2 = Extremes(Curve=outer_chine_2, Plane=PlaneYZ(0, 0, 0))  # -> Highest, Lowest
pdecon = Deconstruct(Point=eval.Point)  # -> XComponent, YComponent, ZComponent
pdecon_2 = Deconstruct(Point=eval_2.Point)  # -> XComponent, YComponent, ZComponent
pdecon_3 = Deconstruct(Point=x_tremez.Lowest)  # -> XComponent, YComponent, ZComponent
pdecon_4 = Deconstruct(Point=x_tremez_2.Lowest)  # -> XComponent, YComponent, ZComponent
sort = SortList(Keys=pdecon_2.XComponent, ValuesA=eval_2.Point)  # -> Keys, ValuesA
sort_2 = SortList(Keys=pdecon.XComponent, ValuesA=eval.Point)  # -> Keys, ValuesA
item = ListItem(List=sort_2.ValuesA, Index=0, Wrap=True)  # -> Item, Item1
item_2 = ListItem(List=sort.ValuesA, Index=0, Wrap=True)  # -> Item, Item1
expression = Expression(y=pdecon_3.YComponent, f=f, Expression="ABS(y)*f")
expression_2 = Expression(y=pdecon_4.YComponent, f=f, Expression="ABS(y)*f")
vec2pt = Vector2Pt(PointA=item.Item1, PointB=item.Item, Unitize=True)  # -> Vector, Length
vec2pt_2 = Vector2Pt(PointA=item_2.Item1, PointB=item_2.Item, Unitize=True)  # -> Vector, Length
vdis = VectorDisplay(Anchor=item.Item, Vector=vec2pt.Vector)
vdis_2 = VectorDisplay(Anchor=item_2.Item, Vector=vec2pt_2.Vector)
multiplication = Multiplication(A=flatten(vec2pt.Vector), Mult=expression)
multiplication_2 = Multiplication(A=flatten(vec2pt_2.Vector), Mult=expression_2)
bzspan = BezierSpan(StartPoint=x_tremez.Lowest, StartTangent=multiplication, EndPoint=x_tremez_2.Lowest, EndTangent=multiplication_2)  # -> StemCrv, Length, Domain
stem_crv = ClusterOutput(bzspan.StemCrv)
