# Grasshopper definition stem_srf.gh (Grasshopper 1.0.8)
# Copyright: © SYD 2022
# Copyright: © 2023 SYD all rights reserved

# ---- group: Stem
stem_f = A()

# ----
f = B()
B = Brep()
d1 = Data1()
d2 = Data2()
merge = Merge(Data1=d1, Data2=d2)
dom = ConstructDomain(DomainStart="0", DomainEnd="1")
dom_2 = ConstructDomain(DomainStart="0.5", DomainEnd="1")
dom_3 = ConstructDomain(DomainStart="0", DomainEnd="0.5")
sec = BrepPlane(Brep=B, Plane=Plane(origin=(0, 0, 0), x=(0, 0, 1), y=(1, 0, 0)))  # -> Curves, Points; disabled
dom² = ConstructDomain²(DomainU=dom_2, DomainV=dom)
dom²_2 = ConstructDomain²(DomainU=dom_3, DomainV=dom)
srfsplit = SurfaceSplit(Surface=B, Curves=sec.Curves)  # disabled
subsrf = Isotrim(Surface=reparameterize(B), Domain=dom²_2)
subsrf_2 = Isotrim(Surface=reparameterize(B), Domain=dom²)
debrep = DeconstructBrep(Brep=B)  # -> Faces, Edges, Vertices
srf = Surface([subsrf, subsrf_2])
len = Length(Curve=debrep.Edges)
debrep_2 = DeconstructBrep(Brep=srf)  # -> Faces, Edges, Vertices
sort = SortList(Keys=len, ValuesA=debrep.Edges)  # -> Keys, reverse(ValuesA)
midpt = CurveMiddle(Curve=debrep_2.Edges)
pdecon = Deconstruct(Point=midpt)  # -> XComponent, YComponent, ZComponent
item = ListItem(List=sort.ValuesA, Index=0, Wrap=True)  # -> Item, Item1
sort_2 = SortList(Keys=pdecon.XComponent, ValuesA=debrep_2.Edges)  # -> Keys, ValuesA
item_2 = ListItem(List=sort_2.ValuesA, Index=0, Wrap=True)  # -> Item, Item1
dispatch = Dispatch(List=flatten(item_2.Item), DispatchPattern=[True, False])  # -> ListA, ListB
debrep_3 = DeconstructBrep(Brep=subsrf)  # -> Faces, Edges, Vertices
flip = FlipCurve(Curve=dispatch.ListA)  # -> Curve, Flag
sort_pt = SortPoints(Points=debrep_3.Vertices)  # -> Points, Indices
aligned_front_of_hull_crv = Curve([flip.Curve, dispatch.ListB])
split = SplitList(List=sort_pt.Points, Index=2)  # -> ListA, ListB
shatter = Shatter(Curve=reparameterize(aligned_front_of_hull_crv), Parameters=merge)
pdecon_2 = Deconstruct(Point=split.ListA)  # -> XComponent, YComponent, ZComponent
sort_3 = SortList(Keys=pdecon_2.ZComponent, ValuesA=split.ListA)  # -> Keys, ValuesA
dispatch_2 = Dispatch(List=shatter, DispatchPattern=[True, False])  # -> ListA, ListB
item_3 = ListItem(List=sort_3.ValuesA, Index=Slider(0, range=0..10), Wrap=True)
multiplication = Multiplication(StemF=stem_f, B=f)
crv = Curve(dispatch_2.ListB)
bow_pt = Point(item_3)
pframes = PerpFrames(Curve=crv, Count=6, Align=simplify(True))  # -> Frames, Parameters
outer_chine = Curve(item.Item1)
inner_chine = Curve(item.Item)
sec_2 = BrepPlane(Brep=graft(srf), Plane=pframes.Frames)  # -> simplify(Curves), Points

# ---- group: Stem top
cluster = Cluster(f=multiplication, inner_chine=inner_chine, outer_chine=outer_chine)

# ----
panel = Panel(pframes.Parameters)
trim = TrimTree(Tree=sec_2.Curves, Depth=1)
bang = ExplodeTree(Data=trim)  # -> Branch0, Branch1
flip_2 = FlipCurve(Curve=cluster)  # -> Curve, Flag

# ---- group: Stem mid
cluster_2 = Cluster(f=multiplication, inner_chine=bang.Branch0, outer_chine=bang.Branch1)

# ----
crv_2 = Curve(flatten([flip_2.Curve, cluster_2]))

# ---- group: Stem sides
reb = RebuildCurve(Curve=aligned_front_of_hull_crv, Degree=2, Count=1000, Tangents=True)  # -> flatten(StemSideCrv)

# ----
midpt_2 = CurveMiddle(Curve=crv_2)
pdecon_3 = Deconstruct(Point=midpt_2)  # -> XComponent, YComponent, ZComponent
sort_4 = SortList(Keys=pdecon_3.ZComponent, ValuesStemCrv=crv_2)  # -> Keys, ValuesStemCrv
netsurf = NetworkSurface(CurvesU=reb, CurvesV=sort_4.ValuesStemCrv, Continuity=1)  # -> flatten(StemBase)
midpt_3 = CurveMiddle(Curve=sort_4.ValuesStemCrv)
entwine = Entwine(Branch00=bow_pt, Branch01=midpt_3, FlattenInputs=True)  # -> flatten(Result)
points = PointList(Points=entwine, Size=20)
intcrv = Interpolate(Vertices=entwine, Degree=3, Periodic=False, KnotStyle=1)  # -> ProfileCrv, Length, Domain
C = Curve(flip_2.Curve)
stem_side_crv = Curve(reb)
stem_base = Surface(netsurf)
stem_crv = ValuesStemCrv(sort_4.ValuesStemCrv)
profile_crv = Curve(intcrv.ProfileCrv)

# ==== cluster Cluster
inner_chine = ClusterInput()
outer_chine = ClusterInput()
f = ClusterInput()
panel = Panel("""0
0.001
0.999
1""")
inner_chine_2 = Curve(inner_chine)
outer_chine_2 = Curve(outer_chine)
eval = EvaluateCurve(Curve=reparameterize(graft(inner_chine_2)), Parameter=panel)  # -> Point, Tangent, Angle
eval_2 = EvaluateCurve(Curve=reparameterize(graft(outer_chine_2)), Parameter=panel)  # -> Point, Tangent, Angle
x_tremez = Extremes(Curve=inner_chine_2, Plane=PlaneYZ(0, 0, 0))  # -> Highest, Lowest
x_tremez_2 = Extremes(Curve=outer_chine_2, Plane=PlaneYZ(0, 0, 0))  # -> Highest, Lowest
pdecon = Deconstruct(Point=eval.Point)  # -> XComponent, YComponent, ZComponent
pdecon_2 = Deconstruct(Point=eval_2.Point)  # -> XComponent, YComponent, ZComponent
pdecon_3 = Deconstruct(Point=x_tremez.Lowest)  # -> XComponent, YComponent, ZComponent
pdecon_4 = Deconstruct(Point=x_tremez_2.Lowest)  # -> XComponent, YComponent, ZComponent
sort = SortList(Keys=pdecon_2.XComponent, ValuesA=eval_2.Point)  # -> Keys, ValuesA
sort_2 = SortList(Keys=pdecon.XComponent, ValuesA=eval.Point)  # -> Keys, ValuesA
item = ListItem(List=sort_2.ValuesA, Index=0, Wrap=True)  # -> Item, Item1
item_2 = ListItem(List=sort.ValuesA, Index=0, Wrap=True)  # -> Item, Item1
expression = Expression(y=pdecon_3.YComponent, f=f, Expression="ABS(y)*f")
expression_2 = Expression(y=pdecon_4.YComponent, f=f, Expression="ABS(y)*f")
vec2pt = Vector2Pt(PointA=item.Item1, PointB=item.Item, Unitize=True)  # -> Vector, Length
vec2pt_2 = Vector2Pt(PointA=item_2.Item1, PointB=item_2.Item, Unitize=True)  # -> Vector, Length
vdis = VectorDisplay(Anchor=item.Item, Vector=vec2pt.Vector)
vdis_2 = VectorDisplay(Anchor=item_2.Item, Vector=vec2pt_2.Vector)
multiplication = Multiplication(A=flatten(vec2pt.Vector), Mult=expression)
multiplication_2 = Multiplication(A=flatten(vec2pt_2.Vector), Mult=expression_2)
bzspan = BezierSpan(StartPoint=x_tremez.Lowest, StartTangent=multiplication, EndPoint=x_tremez_2.Lowest, EndTangent=multiplication_2)  # -> StemCrv, Length, Domain
stem_crv = ClusterOutput(bzspan.StemCrv)
